% Simulink data dictionary Datas.sldd

gameSituation = Simulink.Bus()
  ballGameState: double
  ballCurrentPose: double[3 1]
  robotCurrentPose: double[3 4]
  ballLastCommandBy: double[2 1]

robotCommand = Simulink.Bus()
  kick: boolean
  kickProperty: double
  robotDestinationPose: double[3 4]

robotControl = Simulink.Bus()
  kick: boolean
  kickProperty: double
  robotAcceleration: double
  robotHeadingRate: double